# Grasshopper definition DemoComandi.gh (Grasshopper 1.0.8)
# plug-ins: gHowl, LunchBox

udp = UDPReceiver(Address="127.0.0.2", Port="7001", Pattern=0)  # -> Info, Data
panel = Panel(udp.Info)
split = TextSplit(Text=udp.Data, Separators=" ")
number_slider = Slider(6.8, range=0..10)
multiplication = Multiplication(A=split, B="100")
item = ListItem(List=multiplication, Index="1", Wrap=True)
item_2 = ListItem(List=multiplication, Index="0", Wrap=True)
division = Division(A=item, B=Slider(10, range=0..10))
panel_2 = Panel(division)
division_2 = Division(A=item_2, B=Slider(10, range=0..10))
panel_3 = Panel(division_2)
panel_4 = Panel(multiplication)
panel_5 = Panel("controllo slider")
Y = UnitY(Factor=division)
panel_6 = Panel("controllo tirata")
panel_7 = Panel("controllo pinch")
pt = ConstructPoint(XCoordinate=Slider(0, range=0..10), YCoordinate=Slider(0, range=0..10), ZCoordinate=0)
pt_2 = ConstructPoint(XCoordinate=Slider(8.7, range=0..10), YCoordinate=Slider(0, range=0..10), ZCoordinate=Slider(0, range=0..10))
ln = Line(StartPoint=pt_2, EndPoint=pt)
extr = Extrude(Base=ln, Direction=Y)
Z = UnitZ(Factor=division_2)
extr_2 = Extrude(Base=extr, Direction=Z)
mesh = Mesh(extr_2)
mshreduce = MeshReduce(Mesh=mesh, TargetSize=Slider(2000, range=1..4000), Distort=True, Accuracy=5, NormalizeSize=False)
demesh = DeconstructMesh(Mesh=mshreduce)  # -> Vertices, Faces, Colours, Normals
rep = ReplaceText(Text=demesh.Vertices, Find="{", RecursiveReplace=False)
rep_2 = ReplaceText(Text=rep, Find="}", RecursiveReplace=False)
join = TextJoin(Text=rep_2, Join=";")
panel_8 = Panel(join)
udp_2 = UDPSender(Address="127.0.0.1", Port="8002", Pattern=0, Data=join)
py3 = Python3Script(x=udp_2)  # -> out, a; inputs x: list
# ---------- py3: Python ----------
import socket
import Rhino

# Definiamo una variabile persistente per memorizzare lo stato precedente
if "last_data" not in globals():
    globals()["last_data"] = None

# Configurazione di rete (localhost e la porta che hai scelto)
UDP_IP = "127.0.0.1"
UDP_PORT = 8000

# Convertiamo l'input 'x' in una stringa per il confronto
current_data = str(x)

# CONDIZIONE FLUIDA: Invia i dati SOLO se sono diversi dall'ultimo frame
if current_data != globals()["last_data"]:
    
    # Crea il socket UDP al volo
    sock = socket.socket(socket.AF_INET, socket.SOCK_DGRAM)
    
    # Invia la stringa codificata in byte
    sock.sendto(bytes(current_data, "utf-8"), (UDP_IP, UDP_PORT))
    
    # Chiude il socket per liberare la memoria
    sock.close()
    
    # Aggiorna la memoria con i dati appena inviati
    globals()["last_data"] = current_data
    
    # Output visivo in Grasshopper per debug
    a = "Dati Inviati!"
else:
    a = "In attesa di modifiche..."
# ---------- end py3 ----------
