# Grasshopper definition TorsioneTrave.gh (Grasshopper 1.0.8)
# plug-ins: gHowl, LunchBox

udp = UDPReceiver(Address="127.0.0.2", Port="7000", Pattern=0)  # -> Info, Data
panel = Panel(udp.Info)
split = TextSplit(Text=udp.Data, Separators=" ")
item = ListItem(List=split, Index="1", Wrap=True)
item_2 = ListItem(List=split, Index="0", Wrap=True)
panel_2 = Panel(split)
multiplication = Multiplication(A=item_2, B="100")
multiplication_2 = Multiplication(A=item, B="100")
number_slider = Slider(30, range=0..100)
number_slider_2 = Slider(33, range=0..100)
number_slider_3 = Slider(53, range=0..100)
number_slider_4 = Slider(424, range=0..1000)
number_slider_5 = Slider(71, range=0..100)
range = Range(Domain=multiplication_2, Steps=number_slider)
range_2 = Range(Domain=multiplication, Steps=number_slider)
panel_3 = Panel(range)
rad = Radians(Degrees=range_2)
number_slider_6 = Slider(6.51, range=0..10)
num2pt = NumbersToPoints(Numbers=range, Mask="z")
xy = XYPlane(Origin=num2pt)
neg = Negative(Value=number_slider_6)
prot = RotatePlane(Plane=xy, Angle=rad)
dom = ConstructDomain(DomainStart=number_slider_6, DomainEnd=neg)
rectangle = Rectangle(Plane=prot, XSize=dom, YSize=dom, Radius=0)  # -> Rectangle, Length
panel_4 = Panel(dom)
loft = Loft(
    Curves=rectangle.Rectangle,
    Options={Adjust=False, Closed=False, LoftEnds=0, LoftSimp=0, LoftType=0, Rebuild=10, Refit=0.01})
boundary = BoundarySurfaces(Edges=rectangle.Rectangle)
cap = CapHoles(Brep=loft)
Z = UnitZ(Factor=Slider(0.15, range=0..1))
rev = Reverse(Vector=Z)
extr = Extrude(Base=boundary, Direction=rev)
mesh = Mesh(cap)
preview = CustomPreview(Geometry=extr, Material=ColourSwatch(SwatchColor=RGB(255, 255, 125)))
mshreduce = MeshReduce(Mesh=mesh, TargetSize=Slider(500, range=1..4000), Distort=True, Accuracy=5, NormalizeSize=False)
preview_2 = CustomPreview(Geometry=cap, Material=ColourSwatch(SwatchColor=RGB(139, 255, 255)))
demesh = DeconstructMesh(Mesh=mshreduce)  # -> Vertices, Faces, Colours, Normals
rep = ReplaceText(Text=demesh.Vertices, Find="{", RecursiveReplace=False)
rep_2 = ReplaceText(Text=rep, Find="}", RecursiveReplace=False)
join = TextJoin(Text=rep_2, Join=";")
panel_5 = Panel(join)
udp_2 = UDPSender(Address="127.0.0.1", Port="8002", Pattern=0, Data=join)
py3 = Python3Script(x=udp_2)  # -> out, a; inputs x: list
# ---------- py3: Python ----------
import socket
import Rhino

# Definiamo una variabile persistente per memorizzare lo stato precedente
if "last_data" not in globals():
    globals()["last_data"] = None

# Configurazione di rete (localhost e la porta che hai scelto)
UDP_IP = "127.0.0.1"
UDP_PORT = 8000

# Convertiamo l'input 'x' in una stringa per il confronto
current_data = str(x)

# CONDIZIONE FLUIDA: Invia i dati SOLO se sono diversi dall'ultimo frame
if current_data != globals()["last_data"]:
    
    # Crea il socket UDP al volo
    sock = socket.socket(socket.AF_INET, socket.SOCK_DGRAM)
    
    # Invia la stringa codificata in byte
    sock.sendto(bytes(current_data, "utf-8"), (UDP_IP, UDP_PORT))
    
    # Chiude il socket per liberare la memoria
    sock.close()
    
    # Aggiorna la memoria con i dati appena inviati
    globals()["last_data"] = current_data
    
    # Output visivo in Grasshopper per debug
    a = "Dati Inviati!"
else:
    a = "In attesa di modifiche..."
# ---------- end py3 ----------
