# Grasshopper definition paralelepipedo.gh (Grasshopper 1.0.8)
# plug-ins: gHowl, LunchBox

udp = UDPReceiver(Address="127.0.0.2", Port="7000", Pattern=0)  # -> Info, Data
panel = Panel(udp.Info)
split = TextSplit(Text=udp.Data, Separators=" ")
item = ListItem(List=split, Index="1", Wrap=True)
item_2 = ListItem(List=split, Index="0", Wrap=True)
panel_2 = Panel(split)
multiplication = Multiplication(A=item_2, B="100")
multiplication_2 = Multiplication(A=item, B="100")
pt = ConstructPoint(XCoordinate=Slider(60, range=0..100), YCoordinate=Slider(47, range=0..100), ZCoordinate=0)
pt_2 = ConstructPoint(XCoordinate=Slider(36, range=0..100), YCoordinate=Slider(23, range=0..100), ZCoordinate=0)
rec_2pt = Rectangle2Pt(Plane=PlaneXY(0, 0, 0), PointA=pt, PointB=pt_2, Radius=0)  # -> Rectangle, Length
Z = UnitZ(Factor=Slider(2, range=0..100))
extr = Extrude(Base=rec_2pt.Rectangle, Direction=Z)
cap = CapHoles(Brep=extr)
mesh = Mesh(cap)
mshreduce = MeshReduce(Mesh=mesh, TargetSize=Slider(1000, range=1..4000), Distort=True, Accuracy=5, NormalizeSize=False)
demesh = DeconstructMesh(Mesh=mshreduce)  # -> Vertices, Faces, Colours, Normals
rep = ReplaceText(Text=demesh.Vertices, Find="{", RecursiveReplace=False)
rep_2 = ReplaceText(Text=rep, Find="}", RecursiveReplace=False)
join = TextJoin(Text=rep_2, Join=";")
panel_3 = Panel(join)
udp_2 = UDPSender(Address="127.0.0.1", Port="8002", Pattern=0, Data=join)
py3 = Python3Script(x=udp_2)  # -> out, a; inputs x: list
# ---------- py3: Python ----------
import socket
import Rhino

# Definiamo una variabile persistente per memorizzare lo stato precedente
if "last_data" not in globals():
    globals()["last_data"] = None

# Configurazione di rete (localhost e la porta che hai scelto)
UDP_IP = "127.0.0.1"
UDP_PORT = 8000

# Convertiamo l'input 'x' in una stringa per il confronto
current_data = str(x)

# CONDIZIONE FLUIDA: Invia i dati SOLO se sono diversi dall'ultimo frame
if current_data != globals()["last_data"]:
    
    # Crea il socket UDP al volo
    sock = socket.socket(socket.AF_INET, socket.SOCK_DGRAM)
    
    # Invia la stringa codificata in byte
    sock.sendto(bytes(current_data, "utf-8"), (UDP_IP, UDP_PORT))
    
    # Chiude il socket per liberare la memoria
    sock.close()
    
    # Aggiorna la memoria con i dati appena inviati
    globals()["last_data"] = current_data
    
    # Output visivo in Grasshopper per debug
    a = "Dati Inviati!"
else:
    a = "In attesa di modifiche..."
# ---------- end py3 ----------
